# Grasshopper definition Curve_travel.gh (Grasshopper 0.9.76)
# plug-ins: Python Interpreter, Firefly.Core

crv = Curve(<curve referenced from the Rhino model>)
ports_available = COMPortsAvailable()
panel = Panel(ports_available)
divdist = DivideDistance(Curve=crv, Distance=Slider(9.452, range=0..11))  # -> Points, Tangents, Parameters
open_port = OpenClosePort(OpenClosePort=Toggle(True), PortNumber="3", BaudRate="115200")
pdecon = Deconstruct(Point=divdist.Points)  # -> XComponent, YComponent, ZComponent
number_slider = Slider(2, range=0..10)
python = PythonScript(x=pdecon.XComponent, y=pdecon.YComponent)  # -> out, a; inputs x: list, y: list
# ---------- python: Python ----------
print "G20"
print "G90"
print "G00 X0.0000 Y0.0000 F30.0000"

for i, val in enumerate(x):
    print ("G01 X%0.2f Y%0.2f" %(x[i], y[i]))
#totalPts = len(x)
##print totalPts
##print x
#
#for i, val in enumerate(x):
##    print i, val
#    if i%spacing==0:
#        for j in range (i,totalPts):
#            x[j] = x[j]+gap
#for i, val in enumerate(x):
#    print val
##for i in x:
##    print i
# ---------- end python ----------
geo = Geometry(<point referenced from the Rhino model>)
panel_2 = Panel(python.out)
geo_2 = Geometry([<brep referenced from the Rhino model> x102])
item = ListItem(List=pdecon.YComponent, Index=number_slider, Wrap=True)
item_2 = ListItem(List=pdecon.XComponent, Index=number_slider, Wrap=True)
vec = VectorXYZ(XComponent=item_2, YComponent=item, ZComponent=0)  # -> Vector, Length
vec_2 = VectorXYZ(XComponent=0, YComponent=item, ZComponent=0)  # -> Vector, Length
move = Move(Geometry=geo, Motion=vec.Vector)  # -> Geometry, Transform
move_2 = Move(Geometry=geo_2, Motion=vec_2.Vector)  # -> Geometry, Transform
write = SerialWriteGeneric(StartWritingValues=Toggle(False), WriteData=panel_2, PortNumber="3")  # -> ArduinoOutput, StatusMessage
panel_3 = Panel(write.ArduinoOutput)
panel_4 = Panel(write.StatusMessage)
