# Grasshopper definition Firefly1.gh (Grasshopper 0.9.76)
# plug-ins: Firefly.Core

number_slider = Slider(3, range=0..10)
ports_available = COMPortsAvailable()
panel = Panel(ports_available)
number_slider_2 = Slider(10, range=0..10)
number_slider_3 = Slider(10, range=0..10)
open_port = OpenClosePort(OpenClosePort=Toggle(False), PortNumber=number_slider, BaudRate=Slider(115200, range=0..1000000))
write = SerialWriteGeneric(StartWritingValues=Toggle(False), WriteData="G00 X10 Y2", PortNumber=number_slider)  # -> ArduinoOutput, StatusMessage
panel_2 = Panel(write.ArduinoOutput)
panel_3 = Panel(write.StatusMessage)
