# Grasshopper definition Firefly_mouse.gh (Grasshopper 0.9.76)
# plug-ins: Python Interpreter, Firefly.Core

number_slider = Slider(3, range=0..10)
ports_available = COMPortsAvailable()
panel = Panel(ports_available)
md_slider = MDSlider(
    slider_value=Point(0.561951614, 0.2692685011, 0.5),
    SliderMode=0,
    x_domain=Domain(0, 100),
    y_domain=Domain(0, 100),
    z_domain=Domain(0, 1))
open_port = OpenClosePort(OpenClosePort=Toggle(True), PortNumber=number_slider, BaudRate=Slider(115200, range=0..1000000))
pdecon = Deconstruct(Point=md_slider)  # -> XComponent, YComponent, ZComponent
python = PythonScript(x=pdecon.XComponent, y=pdecon.YComponent)  # -> out, a
# ---------- python: Python ----------
x = round(x,2);

print ("G00 X%0.2f Y%0.2f" %(x, y))


#totalPts = len(x)
##print totalPts
##print x
#
#for i, val in enumerate(x):
##    print i, val
#    if i%spacing==0:
#        for j in range (i,totalPts):
#            x[j] = x[j]+gap
#for i, val in enumerate(x):
#    print val
##for i in x:
##    print i
# ---------- end python ----------
write = SerialWriteGeneric(StartWritingValues=Toggle(True), WriteData=python.out, PortNumber=number_slider)  # -> ArduinoOutput, StatusMessage
panel_2 = Panel(python.out)
panel_3 = Panel(write.ArduinoOutput)
panel_4 = Panel(write.StatusMessage)
