# Grasshopper definition Dimple_Halftone_Shopbot Writer.ghx (Grasshopper 0.7.55)

# General Notes: By Andy Payne | LIFT architects
# Copyright 2010 All Rights Reserved
# Tested with Grasshopper Build (0.7.0055)
# 
# The file is meant to be used for academic, and other non-profit institutions for non-commercial, non-profit internal research purposes.
# 
# Technical Support.
# Please email andy@liftarchitects.com if you have specific questions about this file.  I will do my best to answer requests in a timely manner, but I'd like to stress that this file is furnished AS-IS and I am under no obligation to provided technical assistance.
# 
# Disclaimer:
# THIS FILE IS PROVIDED BY Andrew Payne | LIFT Architects AND IS FURNISHED "AS IS".  ANY EXPRESS OR IMPLIED WARRANTIES, INCLUDING, BUT NOT LIMITED TO, THE IMPLIED WARRANTIES OF MERCHANTABILITY AND FITNESS FOR A PARTICULAR PURPOSE ARE DISCLAIMED.  IN NO EVENT SHALL Andrew Payne BE LIABLE FOR ANY DIRECT, INDIRECT, INCIDENTAL, SPECIAL, EXEMPLARY, OR CONSEQUENTIAL DAMAGES (INCLUDING, BUT NOT LIMITED TO, PROCUREMENT OF SUBSTITUTE GOODS OR SERVICES; LOSS OF USE, DATA, OR PROFITS; OR BUSINESS INTERRUPTION) HOWEVER CAUSED AND ON ANY THEORY OF LIABILITY, WHETHER IN CONTRACT, STRICT LIABILITY, OR TORT (INCLUDING NEGLIGENCE OR OTHERWISE) ARISING IN ANY WAY OUT OF THE USE OF THIS FILE, EVEN IF ADVISED OF THE POSSIBILITY OF SUCH DAMAGE.
pt_spacing_inch = Slider(0.625, range=0..1)
frame_offset_inch = Panel("2.875")
frame_offset_inch_2 = Panel("3")
division = Division(A=pt_spacing_inch, B=2)
recgrid = Rectangular(Plane=PlaneXY(0, 0, 0), SizeX=pt_spacing_inch, SizeY=pt_spacing_inch, ExtentX=105, ExtentY=37)  # -> Cells, Points
addition = Addition(A=division, B=frame_offset_inch)
addition_2 = Addition(A=division, B=frame_offset_inch_2)
vec = VectorXYZ(XComponent=addition, YComponent=addition_2, ZComponent=0)  # -> Vector, Length
pt = Point(recgrid.Points)
move = Move(Geometry=pt, Translation=vec.Vector)
flatten = FlattenTree(Data=move, Path="{0}")
image = ImageSampler(
    flatten,
    FilePath="C:\Harvard Courses\Fall 2010\MAS 863\Assignment 3\Grasshopper Shopbot Writer\Dimple_halftone_03.jpg",
    RelativeFilePath=".\Dimple_halftone_03.jpg",
    Interpolate=True,
    Wrap=1,
    Umin=3.3125,
    Umax=68.9375,
    Vmin=3.4375,
    Vmax=26.5625,
    Filter="Value")
bnd = Bounds2D(Coordinates=flatten)
# Notes: The domain of the Image Sampler has to match the bounds of the point grid.  Double-click on the Image Sampler and set the X-domain and Y-domain to match these bounds.
panel = Panel(bnd)
source = Panel("0.0 to 1.0")
# Notes: Remap the Image Sampler values to match the maximum and minimum plunge depths of the router.  In this example, if the pixel is pure white then the router will plunge 0.04" and if the pixel is pure white then the router will plunge 0.4375".
target = Panel("0.04 to 0.4375")
subtraction = Subtraction(A=1, B=image)
output = Panel(subtraction)
remap = RemapNumbers(Values=subtraction, Source=source, Target=target)
# Notes: By changing the Tolerance value to some value above the minimum Target domain (from the Remap component upstream) we can cull out some points that are pure white.  This feature was added to remove points to improve milling time.  If the Tolerance value is below the minimum Target domain, then this will have no effect on your system.
Z = UnitZ(Factor=expr("-F", remap))
tolerance = Slider(0.01, range=0..0.1)
# Notes: This Target Domain corresponds to the hole radius at the minimum and maximum plunges.  You can basically find these numbers by drawing the profile of your bit and determining the cross section widths at the target depths.  These are fed downstream to control a circle approximation of your pattern.
target_2 = Panel("0.08 to 0.75")
larger = LargerThan(FirstNumber=remap, SecondNumber=tolerance)  # -> LargerThan, OrEqualTo
remap_2 = RemapNumbers(Values=remap, Source=target, Target=target_2)
# Notes: This Header Writer component was written specifically for this example.  If your file is significantly different, or if you are trying a different method, you will more than likely need to modify the script to meet your needs.  This is really just a guideline...
X = Slider(72, range=0..72)
Y = Slider(30, range=0..72)
Z_2 = Slider(0.5, range=-0.5..72)
tool = Slider(1, range=0..100)
safe_z = Slider(0.25, range=-0.5..72)
spindle = Slider(9000, range=0..14000)
move_2 = Move(Geometry=flatten, Translation=Z)
home_pt = Point(Point(0, 0, 0))

# ---- group: Top Pts
cull = CullPattern(List=flatten, CullPattern=larger.LargerThan)

# ---- group: Bottom Pts
cull_2 = CullPattern(List=move_2, CullPattern=larger.LargerThan)

# ----
cull_3 = CullPattern(List=remap_2, CullPattern=larger.LargerThan)
header_writer = VBScript(
    Mat_X=X,
    Mat_Y=Y,
    Mat_Z=Z_2,
    HomePos=home_pt,
    SafeZ=safe_z,
    SpindleSpd=spindle,
    ToolNum=tool,
    ToolDesc="V-Bit (90 deg 0.75inch)")  # -> out, A; inputs HomePos: Point3d
# ---------- header_writer: VB ----------
    Dim outmsg As New List(Of String)

    outmsg.Add("'SHOPBOT ROUTER FILE IN INCHES")
    outmsg.Add("'SHOPBOT PART GENERATOR BY ANDREW PAYNE | LIFT ARCHITECTS")
    outmsg.Add("'ALL RIGHTS RESERVED 2010")
    outmsg.Add("'Minimum extent in X = 0.000 Minimum extent in Y = 0.000 Minimum extent in Z = -" & Mat_Z)
    outmsg.Add("'Maximum extent in X = " & Mat_X & " Maximum extent in Y = " & Mat_Y & " Maximum extent in Z = 0.000")
    outmsg.Add("'Length of material in X = " & Mat_X)
    outmsg.Add("'Length of material in Y = " & Mat_Y)
    outmsg.Add("'Depth of material in Z = " & Mat_Z)
    outmsg.Add("'Home Position Information = Bottom Left Corner, Material Surface")
    outmsg.Add("'Home X = " & HomePos.X & " Y = " & HomePos.Y & " Home Z = " & HomePos.Z)
    outmsg.Add("'Rapid clearance gap or Safe Z = " & SafeZ)
    outmsg.Add("'UNITS:Inches")

    'IF %(25) = 1 THEN GOTO UNIT_ERROR	'check to see software is set to standard
    outmsg.Add("'Set program to absolute coordinate mode")
    outmsg.Add("SA")
    outmsg.Add("TR," & SpindleSpd)

    outmsg.Add("'Toolpath Name = Profile " & ToolNum)
    outmsg.Add("'Tool Name = " & ToolDesc)
    outmsg.Add("'Jog Z axis to safe height")
    outmsg.Add("&Tool = " & ToolNum)

    outmsg.Add("c9")
    outmsg.Add("TR," & SpindleSpd)
    outmsg.Add("'Return tool to home in x and y")
    outmsg.Add("C6")
    outmsg.Add("PAUSE 2")

    outmsg.Add("MS,1.7,0.5")
    outmsg.Add("JZ," & SafeZ)
    outmsg.Add("J2,0.000000,0.000000")

    A = outmsg
# ---------- end header_writer ----------
pt_2 = PointXYZ(XComponent=0, YComponent=0, ZComponent=safe_z)

# ---- group: Circle Approximation
cir = Circle(Plane=cull, Radius=expr("r/2", cull_3))

# ---- group: Drill Path
ln = Line(PointA=cull, PointB=cull_2)

# ----
addition_3 = Addition(A=cull, B=pt_2)
graft = GraftTree(Data=addition_3, Strip=False)
graft_2 = GraftTree(Data=cull, Strip=False)
graft_3 = GraftTree(Data=cull_2, Strip=False)
simplify = SimplifyTree(Tree=header_writer.A)
simplify_2 = SimplifyTree(Tree=graft)
simplify_3 = SimplifyTree(Tree=graft_2)
simplify_4 = SimplifyTree(Tree=graft_3)
safe_z_locations_start = Panel(simplify_2)
top_point_locations_start_cut = Panel(simplify_3)
header = Panel(simplify)
bottom_point_locations_end_cut = Panel(simplify_4)
# Remove Brackets
f_x = F1(Function="SubString(x,1,Length(x)-2)", X=safe_z_locations_start)
# Remove Brackets
f_x_2 = F1(Function="SubString(x,1,Length(x)-2)", X=bottom_point_locations_end_cut)
concat = Concatenate(Start="J3, ", End=f_x)
concat_2 = Concatenate(Start="M3, ", End=f_x_2)
concat_3 = Concatenate(Start="J3, ", End=f_x)
weave = Weave(Pattern=[0, 1, 2], Stream0=concat_3, Stream1=concat_2, Stream2=concat, NullGaps=False)
flatten_2 = FlattenTree(Data=weave, Path="{0}")
weaved_list_of_coordinates = Panel(weave)
closing_statement = Panel("J2, 0.0, 0.0")
# Notes: Right-click on the Final ShopBot Part File panel and choose 'Stream Contents'.  Choose a directory on your computer and save the file with a .sbp extension.  For example:
# 
# C:\Users\yourname\dimple_halftone.sbp
# 
# Now, any change you make in the definition will change the g-code and automatically change the shop bot part file needed to mill the piece.
vb = VBScript(header=header, body=flatten_2, closing=closing_statement)  # -> out, A; inputs header: list, body: list, closing: list
# ---------- vb: VB ----------
    Dim i As Integer
    
    Dim output As New List(Of String)
    
    For i = 0 To header.Count - 1
      output.Add(header(i))
    Next
    
    For i = 0 To body.Count - 1
      output.Add(body(i))
    Next
    
    For i = 0 To closing.Count - 1
      output.Add(closing(i))
    Next

    A = output
# ---------- end vb ----------
final_shopbot_part_file = Panel(vb.A)
