# Grasshopper definition day4.gh (Grasshopper 0.9.76)

crv = Curve([<curve referenced from the Rhino model> x2])
number_slider = Slider(10, range=0..100)
loft = Loft(Curves=crv, Options={Adjust=False, Closed=False, LoftEnds=0, LoftSimp=0, LoftType=0, Rebuild=10, Refit=0.01})
divide = DivideDomain²(Domain=loft, UCount=number_slider, VCount=number_slider)
subsrf = Isotrim(Surface=loft, Domain=divide)
Z = UnitZ(Factor=Slider(5, range=0..10))
debrep = DeconstructBrep(Brep=subsrf)  # -> Faces, Edges, Vertices
random = Random(Range=Domain(0, 1), Number=Slider(100, range=0..310), Seed=2)
area = Area(Geometry=flatten(debrep.Faces))  # -> Area, Centroid
Z_2 = UnitZ(Factor=random)
multiplication = Multiplication(A=Z_2, B=Slider(7, range=0..100))
move = Move(Geometry=area.Centroid, Motion=Z)  # -> Geometry, Transform
move_2 = Move(Geometry=debrep.Faces, Motion=graft(multiplication))  # -> Geometry, Transform
path_mapper = PathMapper(move.Geometry, source="{A}(i)", target="{i\10}")
flip = FlipMatrix(Data=path_mapper)
ln = Line(StartPoint=debrep.Vertices, EndPoint=graft(move.Geometry))
pline = PolyLine(Vertices=flip, Closed=False)
pline_2 = PolyLine(Vertices=path_mapper, Closed=False)
sph = Sphere(Base=debrep.Vertices, Radius=Slider(0.3, range=0..1))
pipe = Pipe(Curve=[ln, pline_2, pline, debrep.Edges], Radius=Slider(0.1, range=0..1), Caps=0)
